# Grasshopper definition grasshopper_to_place_cone.gh (Grasshopper 1.0.8)

pt = Point(Point(2409.247621, 1159.851361, 1369.105749))
pt_2 = Point(Point(0, 0, 0))
brep = Brep(<brep referenced from the Rhino model>)
cluster = Cluster(
    Y=Slider(2679.7, range=0..5000),
    cone_area_width=Slider(406.4, range=0..1000),
    N=Slider(200, range=0..1000),
    C=Slider(6, range=1..50),
    cone_x=Slider(910.5, range=0..5000),
    B_2=Slider(157, range=-1000..1000),
    G=brep,
    A=pt_2,
    B=pt,
    cone_y=Slider(80, range=0..1000))  # -> cones, total_cones
panel = Panel(cluster.total_cones)

# ==== cluster Cluster
cone_area_width = ClusterInput()
cone_x = ClusterInput()
cone_y = ClusterInput()
panel = Panel(cone_y)
panel_2 = Panel(cone_x)
panel_3 = Panel(cone_area_width)
A = ClusterInput()
B = ClusterInput()
N = ClusterInput()
C = ClusterInput()
B_2 = ClusterInput()
Y = ClusterInput()
vec2pt = Vector2Pt(PointA=A, PointB=B, Unitize=False)  # -> Vector, Length
series = Series(Start=0, Step=N, Count=C)
pt = ConstructPoint(XCoordinate=panel, YCoordinate=panel_2, ZCoordinate=0)
subtraction = Subtraction(A=panel_3, B=panel)
addition = Addition(A=panel_2, B=B_2)
rectangle = Rectangle(Plane=PlaneXY(0, 0, 0), XSize=panel_3, YSize=Y, Radius=0)  # -> Rectangle, Length
pt_2 = ConstructPoint(XCoordinate=subtraction, YCoordinate=addition, ZCoordinate=0)
Y_2 = UnitY(Factor=series)
move = Move(Geometry=rectangle.Rectangle, Motion=vec2pt.Vector)  # -> Geometry, Transform
merge = Merge(Data1=pt, Data2=pt_2)
move_2 = Move(Geometry=graft(merge), Motion=Y_2)  # -> Geometry, Transform
G = ClusterInput()
move_3 = Move(Geometry=move_2.Geometry, Motion=vec2pt.Vector)  # -> Geometry, Transform
move_4 = Move(Geometry=G, Motion=move_3.Geometry)  # -> Geometry, Transform
lng = ListLength(List=flatten(move_4.Geometry))
cones = ClusterOutput(move_4.Geometry)
total_cones = ClusterOutput(lng)
